# Grasshopper definition RhinoExporter.gh (Grasshopper 1.0.7)

# ---- group: Sample 3
mergeneighbours = Panel("1")
reflect_x = Panel("""1
2
3
4
5
6
7
9
10
11
12
13
15
16
18
19
21
25
26
27
28
29
30
31
32
34
35
36""")
panel = Panel("""Standard
Facade
Column
Beam
Bathroom
Circulation
Empty""")
xy_dimension = Slider(6, range=0..30)
z_dimension = Slider(7, range=0..10)
y_tiles = Slider(4, range=0..10)
x_tiles = Slider(3, range=0..10)
z_tiles = Slider(3, range=0..10)
panel_2 = Panel("D:\Unity\School\ALIS_WFC\WaveFunctionCollapseUnity\RhinoExporter\Auto\")
panel_3 = Panel("Instances")
panel_4 = Panel("block")
reflect_y = Panel("""1
2
3
4
5
6
7
10
11
12
13
15
16
18
19
25
26
27
28
29
30
31
34
35
36""")
number_slider = Slider(1, range=0..5)
reflect_z = Panel("""1
2
3
5
6
7
13
19
25
26
27
28
29
30
31
34
35
36""")
number_slider_2 = Slider(0, range=0..10)
exportmesh = BooleanToggle(False)
export = Button()
tilesize = ConstructPoint(XCoordinate=xy_dimension, YCoordinate=xy_dimension, ZCoordinate=z_dimension)
numberoftiles = ConstructPoint(XCoordinate=x_tiles, YCoordinate=y_tiles, ZCoordinate=z_tiles)
rotate = Panel("""1
2
3
4
5
6
7
8
9
10
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""")

# ---- group: INPUT Sample one / INPUT
mergeneighbours_2 = Panel("1-5-13-16-20-29")
reflect_x_2 = Panel("""1
4
5
6
8
10
13
14
16
20
21
22
23
24
26
27
29
30
31
36
37
38
39
40
42
43
44
46
47
48""")
z_dimension_2 = Slider(7, range=0..10)
xy_dimension_2 = Slider(6, range=0..30)
x_tiles_2 = Slider(4, range=0..10)
y_tiles_2 = Slider(4, range=0..10)
z_tiles_2 = Slider(3, range=0..10)
reflect_y_2 = Panel("""1
4
5
6
8
9
10
12
13
14
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""")
number_slider_3 = Slider(1, range=0..5)
reflect_z_2 = Panel("""2
5
9
12""")
number_slider_4 = Slider(0, range=0..10)
exportmesh_2 = BooleanToggle(False)
export_2 = Button()
tilesize_2 = ConstructPoint(XCoordinate=xy_dimension_2, YCoordinate=xy_dimension_2, ZCoordinate=z_dimension_2)
numberoftiles_2 = ConstructPoint(XCoordinate=x_tiles_2, YCoordinate=y_tiles_2, ZCoordinate=z_tiles_2)

# ---- group: INPUT Sample one
rotate_2 = Panel("""1
4
5
6
8
10
13
14
16
20
21
22
23
24
26
29
30
36
37
38
39
40
42
43
44
46
47""")

# ----
panel_11 = Panel("D:\Unity\School\ALIS_WFC\WaveFunctionCollapseUnity\RhinoExporter\")
panel_12 = Panel("D:\Unity\School\ALIS_WFC\WaveFunctionCollapseUnity\RhinoExporter\Auto\")

# ---- group: INPUT
panel_13 = Panel("D:\Unity\School\ALIS_WFC\WaveFunctionCollapseUnity\RhinoExporter\Auto\")
panel_14 = Panel("""Standard
Facade
Column
Beam
Bathroom
Circulation
Empty""")
panel_15 = Panel("4")
panel_16 = Panel("4")
panel_17 = Panel("3")
panel_18 = Panel("3")
panel_19 = Panel("1")
panel_20 = Panel("Instances")
panel_21 = Panel("block")
number_slider_5 = Slider(1, range=0..5)
number_slider_6 = Slider(0, range=0..10)
button = Button()
tilesize_3 = ConstructPoint(XCoordinate=panel_15, YCoordinate=panel_16, ZCoordinate="6")
numberoftiles_3 = ConstructPoint(XCoordinate=panel_17, YCoordinate=panel_18, ZCoordinate=panel_19)

# ----
panel_22 = Panel("0")
panel_23 = Panel("""Standard
Facade
Column
Beam
Bathroom
Circulation
Empty""")
pt = Point(<point referenced from the Rhino model>)
pt_2 = Point(<point referenced from the Rhino model>)
series = Series(Start=1, Step=1, Count=Slider(27, range=0..150))  # -> flatten(Series)

# ---- group: INPUT
mergeneighbours_3 = Panel("11-13")
reflect_x_3 = Panel("""1
2
3
4
5
6
7
8
9
10
11
12
13
14
15
16
17
18""")
panel_24 = Panel("""Standard
Facade
Column
Beam
Bathroom
Circulation
Empty""")
xy_dimension_3 = Slider(6, range=0..10)
z_dimension_3 = Slider(7, range=0..10)
y_tiles_3 = Slider(3, range=0..10)
z_tiles_3 = Slider(2, range=0..10)
x_tiles_3 = Slider(3, range=0..10)
panel_25 = Panel("D:\Unity\School\ALIS_WFC\WaveFunctionCollapseUnity\RhinoExporter\Auto\")
panel_26 = Panel("Instances")
panel_27 = Panel("block")
reflect_y_3 = Panel("""1
2
3
4
5
6
7
8
9
10
11
12
13
14
15
16
18""")
number_slider_7 = Slider(1, range=0..5)
panel_28 = Panel("1")
reflect_z_3 = Panel("""1
2
3
4
6
10
11
12
13
14
15""")
number_slider_8 = Slider(0, range=0..10)
button_2 = Button()
tilesize_4 = ConstructPoint(XCoordinate=xy_dimension_3, YCoordinate=xy_dimension_3, ZCoordinate=z_dimension_3)
numberoftiles_4 = ConstructPoint(XCoordinate=x_tiles_3, YCoordinate=y_tiles_3, ZCoordinate=z_tiles_3)

# ----
dist = Distance(PointA=pt, PointB=pt_2)
panel_29 = Panel("""Standard
Facade
Column
Beam
Bathroom
Circulation
Empty""")
number_slider_9 = Slider(0, range=0..10)

# ---- group: INPUT
mergeneighbours_4 = Panel("1")
reflect_x_4 = Panel("""1
2
3
4
5
6
7
9
10
11
12
13
15
16
18
19
21
25
26
27
28
29
30
31
32
34
35
36""")
voxelsize_3 = Panel("1")
panel_30 = Panel("""Standard
Facade
Column
Beam
Bathroom
Circulation
Empty""")
z_dimension_4 = Slider(7, range=0..10)
xy_dimension_4 = Slider(6, range=0..30)
y_tiles_4 = Slider(4, range=0..10)
x_tiles_4 = Slider(3, range=0..10)
z_tiles_4 = Slider(3, range=0..10)
panel_31 = Panel("D:\Unity\School\ALIS_WFC\WaveFunctionCollapseUnity\RhinoExporter\Auto\")
panel_32 = Panel("Instances")
panel_33 = Panel("block")
reflect_y_4 = Panel("""1
2
3
4
5
6
7
10
11
12
13
15
16
18
19
25
26
27
28
29
30
31
34
35
36""")
number_slider_10 = Slider(1, range=0..5)
panel_34 = Panel("1")
reflect_z_4 = Panel("""1
2
3
5
6
7
13
19
25
26
27
28
29
30
31
34
35
36""")
number_slider_11 = Slider(0, range=0..10)
exportmesh_3 = BooleanToggle(False)
export_3 = Button()
tilesize_5 = ConstructPoint(XCoordinate=xy_dimension_4, YCoordinate=xy_dimension_4, ZCoordinate=z_dimension_4)
numberoftiles_5 = ConstructPoint(XCoordinate=x_tiles_4, YCoordinate=y_tiles_4, ZCoordinate=z_tiles_4)

# ----
pt_3 = ConstructPoint(XCoordinate="12", YCoordinate="12", ZCoordinate="13")
pt_4 = Point([<point referenced from the Rhino model> x4])
number_slider_12 = Slider(0, range=0..10)
number_slider_13 = Slider(4, range=0..100)
path = FilePath("C:\Users\Kevin\Desktop\WFC\RhinoExporter\Export\ExportSeed1190.xml")
rotate_3 = Panel("""1
2
3
4
5
6
10
11
12
13
14
15""")
pt_5 = ConstructPoint(XCoordinate="12", YCoordinate="12", ZCoordinate="13")
pt_6 = Point([<point referenced from the Rhino model> x4])

# ---- group: INPUT
rotate_4 = Panel("""1
2
3
4
5
6
7
8
9
10
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""")

# ----
panel_35 = Panel(path)
importer = CSharpScript(Import=Button(), Filename=path, BlockNames="block", InstanceLayer="Instances")  # -> out, A; inputs Import: Boolean, Filename: String, BlockNames: String, InstanceLayer: String
# ---------- importer: C# usings ----------
  using System.Linq;
  using System.Xml;
  using System.Xml.Serialization;
using System.Text;
using System.IO;
  using Rhino.DocObjects;
# ---------- importer: C# ----------
    if(Import)
    {
      var assembly = new Assembly();
      assembly.DeserializeObject(Filename);

     /* A = assembly.Instances[3].DefinitionIndex;
      Rhino.RhinoApp.WriteLine(assembly.Instances.Count + "instances loaded");
      foreach (var instance in assembly.Instances)
      {
        Rhino.RhinoApp.Write(instance.Pose.Rotation.ToQuaternion().A + " ");
      }*/



      // Instantiate deserialised instances

      Rhino.DocObjects.InstanceDefinition block = RhinoDocument.InstanceDefinitions.Find(BlockNames);
      foreach (var instance in assembly.Instances)
      {
        Quaternion rotation = instance.Pose.Rotation.ToQuaternion();//.MatrixForm();
        Plane plane;
        rotation.GetRotation(out plane);
        plane.Origin = instance.Pose.Position.ToPoint3d();
        var transform = Transform.PlaneToPlane(Plane.WorldXY, plane);
        // Transform translation = Transform.Translation(instance.Pose.Position.ToVector3d());

        //Transform transform = rotation;

        Int32 instantDef = (int) block.InstanceDefinitionModelSerialNumber;
        var newObject = RhinoDocument.Objects.AddInstanceObject(instantDef, transform);


      }
    }
# ---------- importer: C# additional code ----------
  public class Assembly
  {
    public List<Instance> Instances;

    public void DeserializeObject(string filename)
    {
      XmlSerializer serializer = new XmlSerializer(typeof(Assembly));

      FileStream fs = new FileStream(filename, FileMode.OpenOrCreate);
      TextReader reader = new StreamReader(fs);

      Assembly assembly;
      assembly = (Assembly) serializer.Deserialize(reader);

      Instances = assembly.Instances;
    }
  }

  public struct Instance
  {
    public int DefinitionIndex;
    public ImportedPose Pose;
  }

  public struct ImportedPose
  {
    public ImportedVector3 Position;
    public ImportedQuaternion Rotation;
  }

  public struct ImportedVector3
  {
    public double X;
    public double Y;
    public double Z;

    public Point3d ToPoint3d()
    {
      return new Point3d(X, Y, Z);
    }
  }

  public struct ImportedQuaternion
  {
    public double A;
    public double B;
    public double C;
    public double D;

    public Vector3d ToEuler()
    {
      double xd = A / (1 - D);
      double yd = B / (1 - D);
      double zd = C / (1 - D);

      Vector3d outPoint = new Vector3d(xd, yd, zd);
      return outPoint;
    }

    public Quaternion ToQuaternion()
    {
      return new Quaternion(A, B, C, D);
    }
  }
# ---------- end importer ----------
multiplesampleexporternoconnection = CSharpScript(
    Export=button_2,
    Path=panel_25,
    BlockNames=panel_27,
    InstanceLayer=panel_26,
    density=number_slider_7,
    type=number_slider_8,
    TileDimension=tilesize_4,
    NumberOfTiles=numberoftiles_4,
    EmptyTile=panel_28,
    ReflectX=reflect_x_3,
    ReflectY=reflect_y_3,
    ReflectZ=reflect_z_3,
    Rotate=rotate_3,
    MergeNeighbours=mergeneighbours_3)  # -> out, ZeroPoints, A; inputs Export: Boolean, Path: String, BlockNames: list of String, InstanceLayer: String, density: Int32, type: Int32, TileDimension: Vector3d, NumberOfTiles: Vector3d, EmptyTile: Int32, ReflectX: list of Int32, ReflectY: list of Int32, ReflectZ: list of Int32, Rotate: list of Int32, MergeNeighbours: String
# ---------- multiplesampleexporternoconnection: C# usings ----------
  using System.Linq;
  using System.Xml;
  using System.Xml.Serialization;
  using Rhino.DocObjects;
# ---------- multiplesampleexporternoconnection: C# ----------
    int counter = 0;
    List<Vector3d> outA = new List<Vector3d>();
    List<string> neighbourGroupsString = MergeNeighbours.Split('-').ToList();
    List<List<int>> neighbourGroups = new List<List<int>>();
    foreach (var neighbourGroup in neighbourGroupsString)
    {
      neighbourGroups.Add(neighbourGroup.Split(':').Select(s => int.Parse(s)).ToList());
    }

    A = neighbourGroups;

    for (int z = 0; z < NumberOfTiles.Z; z++)
    {
      for (int y = 0; y < NumberOfTiles.Y; y++)
      {
        for (int x = 0; x < NumberOfTiles.X; x++)
        {
          counter++;
          //Check reflections and rotations
          bool refX = ReflectX.Contains(counter);
          bool refY = ReflectY.Contains(counter);
          bool refZ = ReflectZ.Contains(counter);
          bool rotate = Rotate.Contains(counter);

          //Get the neighbours to merge
          List<int> mergeNeighbours = new List<int>();
          for (int i = 0; i < neighbourGroups.Count; i++)
          {
            if(neighbourGroups[i].Contains(counter))mergeNeighbours = neighbourGroups[i];
          }


          String filename = Path + "Sample_" + counter + "_x" + x + "y" + y + "z" + z + ".xml";
          var zeroPoint = new Vector3d (x * TileDimension.X, y * TileDimension.Y, z * TileDimension.Z);
          outA.Add(zeroPoint);

          //set neighbours
          var neighbours = new List<Neighbour>()
            {
              new Neighbour(x == 0 ? counter + (int) (NumberOfTiles.X - 1) : counter - 1),
              new Neighbour(x + 1 == NumberOfTiles.X ? counter - ((int) NumberOfTiles.X - 1) : counter + 1),
              new Neighbour(z == 0 ? counter + (int) (NumberOfTiles.X * NumberOfTiles.Y * (NumberOfTiles.Z - 1)) : counter - (int) (NumberOfTiles.X * NumberOfTiles.Y)),
              new Neighbour(z + 1 == NumberOfTiles.Z ? counter - (int) (NumberOfTiles.X * NumberOfTiles.Y * (NumberOfTiles.Z - 1)) : counter + (int) (NumberOfTiles.X * NumberOfTiles.Y)),
              new Neighbour(y == 0 ? counter + (int) (NumberOfTiles.X * (NumberOfTiles.Y - 1)) : counter - (int) NumberOfTiles.X),
              new Neighbour(y + 1 == NumberOfTiles.Y ? counter - (int) (NumberOfTiles.X * (NumberOfTiles.Y - 1)) : counter + (int) NumberOfTiles.X)
              };

          if(Export)
          {
            Assembly.Export(BlockNames, InstanceLayer, filename, Rhino.RhinoDoc.ActiveDoc, counter, density, type, zeroPoint,
              TileDimension, new Vector3d(x, z, y), neighbours, refX, refY, refZ, rotate, mergeNeighbours);
          }

        }
      }
    }
    ZeroPoints = outA;

    //assembly.Export(BlockNames,IntanceLayer,1,1,1,Filename,
# ---------- multiplesampleexporternoconnection: C# additional code ----------
  //Reduced version of the Extensions Unity Exporter script by Vicente
  public class Assembly
  {
    public List<Instance> Instances { get; set; }
    public List<Neighbour> Neighbours { get; set;}
    public int Id;
    public int Density;
    public int Type;
    public Vector3Export Index;
    public bool ReflectX;
    public bool ReflectY;
    public bool ReflectZ;
    public bool Rotate;
    public List<int> MergeNeighbours;
    private Assembly() { }


    public static void Export(List<string> blockNames, string instanceLayerName, string fileName,
      RhinoDoc doc, int id, int density, int type, Vector3d zeroPoint, Vector3d dimensions,
      Vector3d index, List<Neighbour> neighbours, bool refX, bool refY, bool refZ, bool rotate, List<int>mergeNeighbours)
    {
      var definitions = blockNames.Select(n => doc.InstanceDefinitions.First(i => i.Name == n));
      var instanceLayer = doc.Layers.FindName(instanceLayerName);

      var assembly = new Assembly()
        {

          Instances = definitions
          .SelectMany(d => d.GetReferences(1).Where(i => i.Attributes.LayerIndex == instanceLayer.Index))
          .Where(d => CheckInsideTile(zeroPoint, d.InstanceXform, dimensions))
          .Select(d => new Instance(d.InstanceDefinition.Index, d.InstanceXform, zeroPoint))
          .ToList(),

          Id = id,
          Density = density,
          Type = type,
          Index = new Vector3Export((Point3d) index),
          Neighbours = neighbours,
          ReflectX = refX,
          ReflectZ = refY,//reverse for unity y up
          ReflectY = refZ,
          Rotate = rotate,
          MergeNeighbours = mergeNeighbours
          };


      var serializer = new XmlSerializer(typeof(Assembly));
      using (var writer = XmlWriter.Create(fileName))
      {
        serializer.Serialize(writer, assembly);
      }
    }

    static bool CheckInsideTile(Vector3d zeroPoint, Transform pointToCheck, Vector3d dimensions)
    {
      var plane = Plane.WorldXY;
      plane.Transform(pointToCheck);
      float tol = 0.1f;
      bool inside = true;
      if (plane.Origin.X < zeroPoint.X - tol || plane.Origin.X >= zeroPoint.X + dimensions.X - tol)inside = false;
      if (plane.Origin.Y < zeroPoint.Y - tol || plane.Origin.Y >= zeroPoint.Y + dimensions.Y - tol)inside = false;
      if (plane.Origin.Z < zeroPoint.Z - tol || plane.Origin.Z >= zeroPoint.Z + dimensions.Z - tol)inside = false;

      return inside;
    }
  }

  public class Neighbour
  {
    public List<int> Neighbours;

    private Neighbour(){}
    public Neighbour(List<int> neighbours)
    {
      Neighbours = neighbours;
    }

    public Neighbour(int neighbour)
    {
      Neighbours = new List<int>();
      Neighbours.Add(neighbour);
    }
  }

  public class Instance
  {
    public int DefinitionIndex;
    public Pose Pose;


    private Instance() { }

    public Instance(int definitionIndex, Transform transform, Vector3d zeroPoint)
    {
      DefinitionIndex = definitionIndex;

      var plane = Plane.WorldXY;
      plane.Transform(transform);
      Pose = new Pose(plane, zeroPoint);
    }
  }

  [XmlType(TypeName = "Vector3")]
  public struct Vector3Export
  {
    public float x, y, z;

    public Vector3Export(Point3d point)
    {
      x = (float) point.X;
      y = (float) point.Z;
      z = (float) point.Y;
    }

    public Vector3Export(Point3f point)
    {
      x = point.X;
      y = point.Z;
      z = point.Y;
    }
  }

  [XmlType(TypeName = "Vector2")]
  public struct Vector2Export
  {
    public float x, y;

    public Vector2Export(Point2f point)
    {
      x = point.X;
      y = point.Y;
    }
  }

  public struct Pose
  {
    public Vector3Export position;
    public QuaternionExport rotation;

    public Pose(Plane plane, Vector3d zeroPoint)
    {
      position = new Vector3Export(plane.Origin - zeroPoint);
      rotation = new QuaternionExport(plane);
    }
  }

  [XmlType(TypeName = "Quaternion")]
  public struct QuaternionExport
  {
    public float x, y, z, w;

    public QuaternionExport(Plane plane)
    {
      var q = Quaternion.Rotation(Plane.WorldXY, plane);

      w = (float) -q.A;
      x = (float) q.B;
      y = (float) q.D;
      z = (float) q.C;
    }
  }
# ---------- end multiplesampleexporternoconnection ----------
onesampleexporter = CSharpScript(
    Export=Button(),
    Path=panel_11,
    BlockNames="block",
    InstanceLayer="Instances",
    id=Slider(4, range=0..100),
    density=Slider(1, range=0..5),
    type=number_slider_9,
    minX="3",
    plusX="3",
    minY="3",
    plusY="3",
    minZ="5",
    plusZ="5",
    ZeroPoint=pt_4,
    TileDimension=pt_3)  # -> out; inputs Export: Boolean, Path: String, BlockNames: list of String, InstanceLayer: String, id: Int32, density: Int32, type: Int32, minX: list of Int32, plusX: list of Int32, minY: list of Int32, plusY: list of Int32, minZ: list of Int32, plusZ: list of Int32, ZeroPoint: Vector3d, TileDimension: Vector3d
# ---------- onesampleexporter: C# ----------
    String filename = Path + "Sample_" + id + ".xml";

    if(Export)
      Assembly.Export(BlockNames, InstanceLayer, filename, Rhino.RhinoDoc.ActiveDoc, minX, plusX, minY, plusY, minZ, plusZ, id, density, type, ZeroPoint, TileDimension);

    //assembly.Export(BlockNames,IntanceLayer,1,1,1,Filename,
# ---------- onesampleexporter: C# additional code ----------
  //Reduced version of the Extensions Unity Exporter script by Vicente
  public class Assembly
  {
    public List<Instance> Instances { get; set; }
    public List<Neighbour> Neighbours { get; set;}
    public int Id;
    public int Density;
    public int Type;
    private Assembly() { }

    public static void Export(List<string> blockNames, string instanceLayerName, string fileName, RhinoDoc doc, List<int>minX, List<int>plusX,
      List<int>minY, List<int>plusY, List<int>minZ, List<int>plusZ, int id, int density, int type, Vector3d zeroPoint, Vector3d dimensions)
    {
      var definitions = blockNames.Select(n => doc.InstanceDefinitions.First(i => i.Name == n));
      var instanceLayer = doc.Layers.FindName(instanceLayerName);

      var assembly = new Assembly()
        {

          Instances = definitions
          .SelectMany(d => d.GetReferences(1).Where(i => i.Attributes.LayerIndex == instanceLayer.Index))
          .Where(d => CheckInsideTile(zeroPoint, d.InstanceXform, dimensions))
          .Select(d => new Instance(d.InstanceDefinition.Index, d.InstanceXform, zeroPoint))
          .ToList()
          };



      assembly.Neighbours = new List<Neighbour>(){
          new Neighbour(minX),
          new Neighbour(plusX),
          new Neighbour(minZ),
          new Neighbour(plusZ),
          new Neighbour(minY),
          new Neighbour(plusY)};
      assembly.Id = id;
      assembly.Density = density;
      assembly.Type = type;

      var serializer = new XmlSerializer(typeof(Assembly));
      using (var writer = XmlWriter.Create(fileName))
      {
        serializer.Serialize(writer, assembly);
      }
    }

    static bool CheckInsideTile(Vector3d zeroPoint, Transform pointToCheck, Vector3d dimensions)
    {
      var plane = Plane.WorldXY;
      plane.Transform(pointToCheck);
      bool inside = false;
      if (plane.Origin.X >= zeroPoint.X && plane.Origin.X <= zeroPoint.X + dimensions.X)inside = true;
      if (inside && plane.Origin.Y >= zeroPoint.Y && plane.Origin.Y <= zeroPoint.Y + dimensions.Y)inside = true;
      if (inside && plane.Origin.Z >= zeroPoint.Z && plane.Origin.Z <= zeroPoint.Z + dimensions.Z)inside = true;

      return inside;
    }
  }

  public class Neighbour
  {
    public List<int> Neighbours;

    private Neighbour(){}
    public Neighbour(List<int> neighbours)
    {
      Neighbours = neighbours;
    }
  }

  public class Instance
  {
    public int DefinitionIndex;
    public Pose Pose;


    private Instance() { }

    public Instance(int definitionIndex, Transform transform, Vector3d zeroPoint)
    {
      DefinitionIndex = definitionIndex;

      var plane = Plane.WorldXY;
      plane.Transform(transform);
      Pose = new Pose(plane, zeroPoint);
    }
  }

  [XmlType(TypeName = "Vector3")]
  public struct Vector3Export
  {
    public float x, y, z;

    public Vector3Export(Point3d point)
    {
      x = (float) point.X;
      y = (float) point.Z;
      z = (float) point.Y;
    }

    public Vector3Export(Point3f point)
    {
      x = point.X;
      y = point.Z;
      z = point.Y;
    }
  }

  [XmlType(TypeName = "Vector2")]
  public struct Vector2Export
  {
    public float x, y;

    public Vector2Export(Point2f point)
    {
      x = point.X;
      y = point.Y;
    }
  }

  public struct Pose
  {
    public Vector3Export position;
    public QuaternionExport rotation;

    public Pose(Plane plane, Vector3d zeroPoint)
    {
      position = new Vector3Export(plane.Origin - zeroPoint);
      rotation = new QuaternionExport(plane);
    }
  }

  [XmlType(TypeName = "Quaternion")]
  public struct QuaternionExport
  {
    public float x, y, z, w;

    public QuaternionExport(Plane plane)
    {
      var q = Quaternion.Rotation(Plane.WorldXY, plane);

      w = (float) -q.A;
      x = (float) q.B;
      y = (float) q.D;
      z = (float) q.C;
    }
  }
# ---------- end onesampleexporter ----------
item = ListItem(List=panel_23, Index=number_slider_9, Wrap=False)
rec = DataRecorder(importer.A, DataLimit=-10, RecordData=True)
multiplesampleexporternoconnection_2 = CSharpScript(
    Export=export_3,
    ExportMesh=exportmesh_3,
    Path=panel_31,
    BlockNames=panel_33,
    InstanceLayer=panel_32,
    density=number_slider_10,
    type=number_slider_11,
    TileDimension=tilesize_5,
    VoxelSize=voxelsize_3,
    NumberOfTiles=numberoftiles_5,
    EmptyTile=panel_34,
    ReflectX=reflect_x_4,
    ReflectY=reflect_y_4,
    ReflectZ=reflect_z_4,
    Rotate=rotate_4,
    MergeNeighbours=mergeneighbours_4)  # -> out, ZeroPoints, A; inputs Export: Boolean, ExportMesh: Boolean, Path: String, BlockNames: list of String, InstanceLayer: String, density: Int32, type: Int32, TileDimension: Vector3d, VoxelSize: Double, NumberOfTiles: Vector3d, EmptyTile: Int32, ReflectX: list of Int32, ReflectY: list of Int32, ReflectZ: list of Int32, Rotate: list of Int32, MergeNeighbours: String
# ---------- multiplesampleexporternoconnection_2: C# ----------
    int counter = 0;
    List<Vector3d> outA = new List<Vector3d>();
    List<string> neighbourGroupsString = MergeNeighbours.Split('-').ToList();
    List<List<int>> neighbourGroups = new List<List<int>>();
    foreach (var neighbourGroup in neighbourGroupsString)
    {
      neighbourGroups.Add(neighbourGroup.Split(':').Select(s => int.Parse(s)).ToList());
    }

    A = neighbourGroups;

    for (int z = 0; z < NumberOfTiles.Z; z++)
    {
      for (int y = 0; y < NumberOfTiles.Y; y++)
      {
        for (int x = 0; x < NumberOfTiles.X; x++)
        {
          counter++;
          //Check reflections and rotations
          bool refX = ReflectX.Contains(counter);
          bool refY = ReflectY.Contains(counter);
          bool refZ = ReflectZ.Contains(counter);
          bool rotate = Rotate.Contains(counter);

          //Get the neighbours to merge
          List<int> mergeNeighbours = new List<int>();
          for (int i = 0; i < neighbourGroups.Count; i++)
          {
            if(neighbourGroups[i].Contains(counter))mergeNeighbours = neighbourGroups[i];
          }


          String filename = Path + "Sample_" + counter + "_x" + x + "y" + y + "z" + z + ".xml";
          var zeroPoint = new Vector3d (x * TileDimension.X * VoxelSize, y * TileDimension.Y * VoxelSize, z * TileDimension.Z * VoxelSize);
          outA.Add(zeroPoint);

          //set neighbours
          var neighbours = new List<Neighbour>()
            {
              new Neighbour(x == 0 ? counter + (int) (NumberOfTiles.X - 1) : counter - 1),
              new Neighbour(x + 1 == NumberOfTiles.X ? counter - ((int) NumberOfTiles.X - 1) : counter + 1),
              new Neighbour(z == 0 ? counter + (int) (NumberOfTiles.X * NumberOfTiles.Y * (NumberOfTiles.Z - 1)) : counter - (int) (NumberOfTiles.X * NumberOfTiles.Y)),
              new Neighbour(z + 1 == NumberOfTiles.Z ? counter - (int) (NumberOfTiles.X * NumberOfTiles.Y * (NumberOfTiles.Z - 1)) : counter + (int) (NumberOfTiles.X * NumberOfTiles.Y)),
              new Neighbour(y == 0 ? counter + (int) (NumberOfTiles.X * (NumberOfTiles.Y - 1)) : counter - (int) NumberOfTiles.X),
              new Neighbour(y + 1 == NumberOfTiles.Y ? counter - (int) (NumberOfTiles.X * (NumberOfTiles.Y - 1)) : counter + (int) NumberOfTiles.X)
              };

          if(Export)
          {
            Assembly.Export(BlockNames, InstanceLayer, filename, Rhino.RhinoDoc.ActiveDoc, counter, density,
              type, zeroPoint, TileDimension, (float) VoxelSize, new Vector3d(x, z, y), neighbours, refX, refY, refZ,
              rotate, mergeNeighbours, ExportMesh);
          }

        }
      }
    }
    ZeroPoints = outA;

    //assembly.Export(BlockNames,IntanceLayer,1,1,1,Filename,
# ---------- multiplesampleexporternoconnection_2: C# additional code ----------
  //Reduced version of the Extensions Unity Exporter script by Vicente
  public class Assembly
  {
    public List<Instance> Instances { get; set; }
    public List<ImportedTile>Tiles;
    public List<Neighbour> Neighbours { get; set;}
    public int Id;
    public int Density;
    public int Type;
    public Vector3Export Index;
    public bool ReflectX;
    public bool ReflectY;
    public bool ReflectZ;
    public bool Rotate;
    public List<int> MergeNeighbours;
    public bool Mesh;
    public float VoxelSize;
    public Vector3Export TileSize;


    private Assembly() { }


    public static void Export(List<string> blockNames, string instanceLayerName, string fileName,
      RhinoDoc doc, int id, int density, int type, Vector3d zeroPoint, Vector3d dimensions, float voxelSize,
      Vector3d index, List<Neighbour> neighbours, bool refX, bool refY, bool refZ, bool rotate,
      List<int>mergeNeighbours, bool mesh)
    {
      var definitions = blockNames.Select(n => doc.InstanceDefinitions.First(i => i.Name == n));
      var instanceLayer = doc.Layers.FindName(instanceLayerName);

      var assembly = new Assembly()
        {

          Tiles = mesh ? definitions.Select(d => new ImportedTile(d, density, doc)).ToList() : null,
          Instances = definitions
          .SelectMany(d => d.GetReferences(1).Where(i => i.Attributes.LayerIndex == instanceLayer.Index))
          .Where(d => CheckInsideTile(zeroPoint, d.InstanceXform, dimensions, voxelSize))
          .Select(d => new Instance(d.InstanceDefinition.Index, d.InstanceXform, zeroPoint, voxelSize))
          .ToList(),

          Id = id,
          Density = density,
          Type = type,
          Index = new Vector3Export((Point3d) index),
          Neighbours = neighbours,
          ReflectX = refX,
          ReflectZ = refY,//reverse for unity y up
          ReflectY = refZ,
          Rotate = rotate,
          MergeNeighbours = mergeNeighbours,
          Mesh = mesh,
          VoxelSize = voxelSize,
          TileSize = new Vector3Export ((Point3d) dimensions)

          };


      var serializer = new XmlSerializer(typeof(Assembly));
      using (var writer = XmlWriter.Create(fileName))
      {
        serializer.Serialize(writer, assembly);
      }
    }

    static bool CheckInsideTile(Vector3d zeroPoint, Transform pointToCheck, Vector3d dimensions, float voxelSize)
    {
      var plane = Plane.WorldXY;
      plane.Transform(pointToCheck);
      float tol = 0.1f;
      bool inside = true;
      if (plane.Origin.X < zeroPoint.X - tol || plane.Origin.X >= zeroPoint.X + dimensions.X * voxelSize - tol)inside = false;
      if (plane.Origin.Y < zeroPoint.Y - tol || plane.Origin.Y >= zeroPoint.Y + dimensions.Y * voxelSize - tol)inside = false;
      if (plane.Origin.Z < zeroPoint.Z - tol || plane.Origin.Z >= zeroPoint.Z + dimensions.Z * voxelSize - tol)inside = false;

      return inside;
    }
  }

  public class ImportedTile
  {
    public int Index { get; set; }
    public List<MeshExport> Renderers { get; set; }

    private ImportedTile() { }

    public ImportedTile(InstanceDefinition definition, double density, RhinoDoc doc)
    {
      Index = definition.Index;

      var geometry = definition.GetObjects();

      int renderIndex = doc.Layers.FindName("RenderMesh").Index;

      var renderMeshes = geometry
        .Where(g => g.Attributes.LayerIndex == renderIndex)
        .Select(g => g.Geometry as Mesh)
        .ToList();

      Renderers = renderMeshes.Select(m => new MeshExport(m)).ToList();



    }
  }
  public class MeshExport
  {
    public List<Vector3Export> Vertices { get; set; }
    public List<Vector2Export> TextureCoordinates { get; set; }
    public List<int> Faces { get; set; }

    private MeshExport() { }

    public MeshExport(Mesh mesh)
    {
      mesh.Faces.ConvertQuadsToTriangles();

      Vertices = mesh.Vertices.Select(p => new Vector3Export(p)).ToList();
      TextureCoordinates = mesh.TextureCoordinates.Select(p => new Vector2Export(p)).ToList();
      Faces = mesh.Faces.SelectMany(f => new int[] { f.C, f.B, f.A }).ToList();
    }
  }

  public class Neighbour
  {
    public List<int> Neighbours;

    private Neighbour(){}
    public Neighbour(List<int> neighbours)
    {
      Neighbours = neighbours;
    }

    public Neighbour(int neighbour)
    {
      Neighbours = new List<int>();
      Neighbours.Add(neighbour);
    }
  }

  public class Instance
  {
    public int DefinitionIndex;
    public Pose Pose;


    private Instance() { }

    public Instance(int definitionIndex, Transform transform, Vector3d zeroPoint, float voxelSize)
    {
      DefinitionIndex = definitionIndex;

      var plane = Plane.WorldXY;
      plane.Transform(transform);
      Pose = new Pose(plane, zeroPoint, voxelSize);
    }
  }

  [XmlType(TypeName = "Vector3")]
  public struct Vector3Export
  {
    public float x, y, z;

    public Vector3Export(Point3d point)
    {
      x = (float) point.X;
      y = (float) point.Z;
      z = (float) point.Y;
    }

    public Vector3Export(Point3f point)
    {
      x = point.X;
      y = point.Z;
      z = point.Y;
    }
  }

  [XmlType(TypeName = "Vector2")]
  public struct Vector2Export
  {
    public float x, y;

    public Vector2Export(Point2f point)
    {
      x = point.X;
      y = point.Y;
    }
  }

  public struct Pose
  {
    public Vector3Export position;
    public QuaternionExport rotation;

    public Pose(Plane plane, Vector3d zeroPoint, float voxelSize)
    {
      position = new Vector3Export((plane.Origin - zeroPoint) / voxelSize);
      rotation = new QuaternionExport(plane);
    }
  }

  [XmlType(TypeName = "Quaternion")]
  public struct QuaternionExport
  {
    public float x, y, z, w;

    public QuaternionExport(Plane plane)
    {
      var q = Quaternion.Rotation(Plane.WorldXY, plane);

      w = (float) -q.A;
      x = (float) q.B;
      y = (float) q.D;
      z = (float) q.C;
    }
  }
# ---------- end multiplesampleexporternoconnection_2 ----------
panel_36 = Panel(importer.out)
panel_37 = Panel(rec)
list_item = ListItem(List=panel_30, Index=number_slider_11, Wrap=False)
panel_38 = Panel(multiplesampleexporternoconnection_2.out)
panel_39 = Panel(list_item)
zeropoints = Point(multiplesampleexporternoconnection_2.ZeroPoints)
panel_40 = Panel("Locked")
multiplesampleexporterbypoint = CSharpScript(
    Export=Button(),
    Path=panel_12,
    BlockNames="block",
    InstanceLayer="Instances",
    density=Slider(1, range=0..5),
    type=number_slider_12,
    ZeroPoints=pt_6,
    TileDimension=pt_5)  # -> out; inputs Export: Boolean, Path: String, BlockNames: list of String, InstanceLayer: String, density: Int32, type: Int32, ZeroPoints: list of Vector3d, TileDimension: Vector3d
# ---------- multiplesampleexporterbypoint: C# ----------
    if(Export)

      for (int i = 1; i < ZeroPoints.Count+1; i++)
      {
        String filename = Path + "Sample_" + i + ".xml";
        Assembly.Export(BlockNames, InstanceLayer, filename, Rhino.RhinoDoc.ActiveDoc, i, density, type, ZeroPoints[i-1], TileDimension);
      }



    //assembly.Export(BlockNames,IntanceLayer,1,1,1,Filename,
# ---------- multiplesampleexporterbypoint: C# additional code ----------
  //Reduced version of the Extensions Unity Exporter script by Vicente
  public class Assembly
  {
    public List<Instance> Instances { get; set; }
    public List<Neighbour> Neighbours { get; set;}
    public int Id;
    public int Density;
    public int Type;
    private Assembly() { }

    public static void Export(List<string> blockNames, string instanceLayerName, string fileName, RhinoDoc doc, int id, int density, int type, Vector3d zeroPoint, Vector3d dimensions)
    {
      var definitions = blockNames.Select(n => doc.InstanceDefinitions.First(i => i.Name == n));
      var instanceLayer = doc.Layers.FindName(instanceLayerName);

      var assembly = new Assembly()
        {

          Instances = definitions
          .SelectMany(d => d.GetReferences(1).Where(i => i.Attributes.LayerIndex == instanceLayer.Index))
          .Where(d => CheckInsideTile(zeroPoint, d.InstanceXform, dimensions))
          .Select(d => new Instance(d.InstanceDefinition.Index, d.InstanceXform, zeroPoint))
          .ToList()
          };



      /*assembly.Neighbours = new List<Neighbour>(){
          new Neighbour(minX),
          new Neighbour(plusX),
          new Neighbour(minZ),
          new Neighbour(plusZ),
          new Neighbour(minY),
          new Neighbour(plusY)};*/
      assembly.Id = id;
      assembly.Density = density;
      assembly.Type = type;

      var serializer = new XmlSerializer(typeof(Assembly));
      using (var writer = XmlWriter.Create(fileName))
      {
        serializer.Serialize(writer, assembly);
      }
    }

    static bool CheckInsideTile(Vector3d zeroPoint, Transform pointToCheck, Vector3d dimensions)
    {
      var plane = Plane.WorldXY;
      plane.Transform(pointToCheck);
      bool inside = false;
      if (plane.Origin.X >= zeroPoint.X && plane.Origin.X <= zeroPoint.X + dimensions.X)inside = true;
      if (inside && plane.Origin.Y >= zeroPoint.Y && plane.Origin.Y <= zeroPoint.Y + dimensions.Y)inside = true;
      if (inside && plane.Origin.Z >= zeroPoint.Z && plane.Origin.Z <= zeroPoint.Z + dimensions.Z)inside = true;

      return inside;
    }
  }

  public class Neighbour
  {
    public List<int> Neighbours;

    private Neighbour(){}
    public Neighbour(List<int> neighbours)
    {
      Neighbours = neighbours;
    }
  }

  public class Instance
  {
    public int DefinitionIndex;
    public Pose Pose;


    private Instance() { }

    public Instance(int definitionIndex, Transform transform, Vector3d zeroPoint)
    {
      DefinitionIndex = definitionIndex;

      var plane = Plane.WorldXY;
      plane.Transform(transform);
      Pose = new Pose(plane, zeroPoint);
    }
  }

  [XmlType(TypeName = "Vector3")]
  public struct Vector3Export
  {
    public float x, y, z;

    public Vector3Export(Point3d point)
    {
      x = (float) point.X;
      y = (float) point.Z;
      z = (float) point.Y;
    }

    public Vector3Export(Point3f point)
    {
      x = point.X;
      y = point.Z;
      z = point.Y;
    }
  }

  [XmlType(TypeName = "Vector2")]
  public struct Vector2Export
  {
    public float x, y;

    public Vector2Export(Point2f point)
    {
      x = point.X;
      y = point.Y;
    }
  }

  public struct Pose
  {
    public Vector3Export position;
    public QuaternionExport rotation;

    public Pose(Plane plane, Vector3d zeroPoint)
    {
      position = new Vector3Export(plane.Origin - zeroPoint);
      rotation = new QuaternionExport(plane);
    }
  }

  [XmlType(TypeName = "Quaternion")]
  public struct QuaternionExport
  {
    public float x, y, z, w;

    public QuaternionExport(Plane plane)
    {
      var q = Quaternion.Rotation(Plane.WorldXY, plane);

      w = (float) -q.A;
      x = (float) q.B;
      y = (float) q.D;
      z = (float) q.C;
    }
  }
# ---------- end multiplesampleexporterbypoint ----------
multiplesampleexporterfullyauto2d = CSharpScript(
    Export=button,
    Path=panel_13,
    BlockNames=panel_21,
    InstanceLayer=panel_20,
    density=number_slider_5,
    type=number_slider_6,
    TileDimension=tilesize_3,
    NumberOfTiles=numberoftiles_3)  # -> out, A; inputs Export: Boolean, Path: String, BlockNames: list of String, InstanceLayer: String, density: Int32, type: Int32, TileDimension: Vector3d, NumberOfTiles: Vector3d
# ---------- multiplesampleexporterfullyauto2d: C# ----------
    int counter = 0;
    List<Vector3d> outA = new List<Vector3d>();

    for (int z = 0; z < NumberOfTiles.Z; z++)
    {
      for (int y = 0; y < NumberOfTiles.Y; y++)
      {
        for (int x = 0; x < NumberOfTiles.X; x++)
        {
          counter++;
          String filename = Path + "Sample_x" + x + "y" + y + "z" + z + ".xml";
          var zeroPoint = new Vector3d (x * TileDimension.X, y * TileDimension.Y, z * TileDimension.Z);
          outA.Add(zeroPoint);

          //set neighbours
          var neighbours = new List<Neighbour>()
            {
              new Neighbour(x == 0 ? int.MinValue : counter - 1),
              new Neighbour(x + 1 == NumberOfTiles.X ? int.MinValue : counter),
              new Neighbour(z == 0 ? int.MinValue : (int) (2 * NumberOfTiles.X * NumberOfTiles.Y * NumberOfTiles.Z + counter - (NumberOfTiles.X * NumberOfTiles.Y))),
              new Neighbour(z + 1 == NumberOfTiles.Z ? int.MinValue : (int) (2 * NumberOfTiles.X * NumberOfTiles.Y * NumberOfTiles.Z + counter)),
              new Neighbour(y == 0 ? int.MinValue : (int) (NumberOfTiles.X * NumberOfTiles.Y * NumberOfTiles.Z + counter - NumberOfTiles.X)),
              new Neighbour(y + 1 == NumberOfTiles.Y ? int.MinValue : (int) ( NumberOfTiles.X * NumberOfTiles.Y * NumberOfTiles.Z + counter))
              };

          if(Export)
          {
            Assembly.Export(BlockNames, InstanceLayer, filename, Rhino.RhinoDoc.ActiveDoc, counter, density, type, zeroPoint, TileDimension, new Vector3d(x, z, y), neighbours);
          }

        }
      }
    }
    A = outA;





    //assembly.Export(BlockNames,IntanceLayer,1,1,1,Filename,
# ---------- multiplesampleexporterfullyauto2d: C# additional code ----------
  //Reduced version of the Extensions Unity Exporter script by Vicente
  public class Assembly
  {
    public List<Instance> Instances { get; set; }
    public List<Neighbour> Neighbours { get; set;}
    public int Id;
    public int Density;
    public int Type;
    public Vector3Export Index;
    private Assembly() { }


    public static void Export(List<string> blockNames, string instanceLayerName, string fileName, RhinoDoc doc, int id, int density, int type, Vector3d zeroPoint, Vector3d dimensions, Vector3d index, List<Neighbour> neighbours)
    {
      var definitions = blockNames.Select(n => doc.InstanceDefinitions.First(i => i.Name == n));
      var instanceLayer = doc.Layers.FindName(instanceLayerName);

      var assembly = new Assembly()
        {

          Instances = definitions
          .SelectMany(d => d.GetReferences(1).Where(i => i.Attributes.LayerIndex == instanceLayer.Index))
          .Where(d => CheckInsideTile(zeroPoint, d.InstanceXform, dimensions))
          .Select(d => new Instance(d.InstanceDefinition.Index, d.InstanceXform, zeroPoint))
          .ToList()
          };



      /*assembly.Neighbours = new List<Neighbour>(){
          new Neighbour(minX),
          new Neighbour(plusX),
          new Neighbour(minZ),
          new Neighbour(plusZ),
          new Neighbour(minY),
          new Neighbour(plusY)};*/
      assembly.Id = id;
      assembly.Density = density;
      assembly.Type = type;
      assembly.Index = new Vector3Export((Point3d) index);
      assembly.Neighbours = neighbours;

      var serializer = new XmlSerializer(typeof(Assembly));
      using (var writer = XmlWriter.Create(fileName))
      {
        serializer.Serialize(writer, assembly);
      }
    }

    static bool CheckInsideTile(Vector3d zeroPoint, Transform pointToCheck, Vector3d dimensions)
    {
      var plane = Plane.WorldXY;
      plane.Transform(pointToCheck);
      float tol = 0.1f;
      bool inside = true;
      if (plane.Origin.X < zeroPoint.X - tol || plane.Origin.X >= zeroPoint.X + dimensions.X - tol)inside = false;
      if (plane.Origin.Y < zeroPoint.Y - tol || plane.Origin.Y >= zeroPoint.Y + dimensions.Y - tol)inside = false;
      if (plane.Origin.Z < zeroPoint.Z - tol || plane.Origin.Z >= zeroPoint.Z + dimensions.Z - tol)inside = false;

      return inside;
    }
  }

  public class Neighbour
  {
    public List<int> Neighbours;

    private Neighbour(){}
    public Neighbour(List<int> neighbours)
    {
      Neighbours = neighbours;
    }

    public Neighbour(int neighbour)
    {
      Neighbours = new List<int>();
      Neighbours.Add(neighbour);
    }
  }

  public class Instance
  {
    public int DefinitionIndex;
    public Pose Pose;


    private Instance() { }

    public Instance(int definitionIndex, Transform transform, Vector3d zeroPoint)
    {
      DefinitionIndex = definitionIndex;

      var plane = Plane.WorldXY;
      plane.Transform(transform);
      Pose = new Pose(plane, zeroPoint);
    }
  }

  [XmlType(TypeName = "Vector3")]
  public struct Vector3Export
  {
    public float x, y, z;

    public Vector3Export(Point3d point)
    {
      x = (float) point.X;
      y = (float) point.Z;
      z = (float) point.Y;
    }

    public Vector3Export(Point3f point)
    {
      x = point.X;
      y = point.Z;
      z = point.Y;
    }
  }

  [XmlType(TypeName = "Vector2")]
  public struct Vector2Export
  {
    public float x, y;

    public Vector2Export(Point2f point)
    {
      x = point.X;
      y = point.Y;
    }
  }

  public struct Pose
  {
    public Vector3Export position;
    public QuaternionExport rotation;

    public Pose(Plane plane, Vector3d zeroPoint)
    {
      position = new Vector3Export(plane.Origin - zeroPoint);
      rotation = new QuaternionExport(plane);
    }
  }

  [XmlType(TypeName = "Quaternion")]
  public struct QuaternionExport
  {
    public float x, y, z, w;

    public QuaternionExport(Plane plane)
    {
      var q = Quaternion.Rotation(Plane.WorldXY, plane);

      w = (float) -q.A;
      x = (float) q.B;
      y = (float) q.D;
      z = (float) q.C;
    }
  }
# ---------- end multiplesampleexporterfullyauto2d ----------
item_2 = ListItem(List=panel_29, Index=number_slider_12, Wrap=False)
list_item_2 = ListItem(List=panel_14, Index=number_slider_6, Wrap=False)
button_3 = Button()
list_item_3 = ListItem(List=panel_24, Index=number_slider_8, Wrap=False)
panel_41 = Panel(onesampleexporter)
panel_42 = Panel(item)
panel_43 = Panel(list_item_2)
panel_44 = Panel(multiplesampleexporternoconnection.out)
zeropoints_2 = Point(multiplesampleexporternoconnection.ZeroPoints)
panel_45 = Panel(list_item_3)
panel_46 = Panel(multiplesampleexporterbypoint)
panel_47 = Panel(item_2)
zeropoints_3 = Point(multiplesampleexporterfullyauto2d.A)
panel_48 = Panel(multiplesampleexporterfullyauto2d.out)

# ---- group: Tag
multiplication = Multiplication(A=x_tiles_4, B=y_tiles_4, C=z_tiles_4)
X = UnitX(Factor=".5")
Y = UnitY(Factor=".5")
series_2 = Series(Start=1, Step=1, Count=multiplication)
addition = Addition(A=X, B=Y)
swatch = ColourSwatch(SwatchColor=RGB(32, 112, 133))
move = Move(Geometry=zeropoints, Motion=addition)  # -> Geometry, Transform
tag = TextTag(Location=move.Geometry, Text=series_2, Colour=swatch)

# ----
drawgrid = DrawGrid(A_3=zeropoints, A=xy_dimension_4, A_2=xy_dimension_4, B=voxelsize_3)
geo = Geometry(drawgrid)
drawgrid_2 = DrawGrid(A_3=zeropoints_3, A=panel_15, A_2=panel_16)

# ---- group: Tag
multiplication_2 = Multiplication(A=panel_17, B=panel_18, C=panel_19)
X_2 = UnitX(Factor=".5")
Y_2 = UnitY(Factor=".5")
series_3 = Series(Start=1, Step=1, Count=multiplication_2)
addition_2 = Addition(A=X_2, B=Y_2)
move_2 = Move(Geometry=zeropoints_3, Motion=addition_2)  # -> Geometry, Transform
tag_2 = TextTag(Location=move_2.Geometry, Text=series_3, Colour=ColourSwatch(SwatchColor=RGB(255, 255, 255)))

# ----
geo_2 = Geometry(drawgrid_2)
preview = CustomPreview(Geometry=geo, Material=swatch)
dots = DotDisplay(Point=zeropoints, Colour=swatch, Size=Slider(0.021, range=0..1))

# ---- group: Tag
multiplication_3 = Multiplication(A=x_tiles_3, B=y_tiles_3, C=z_tiles_3)
X_3 = UnitX(Factor=".5")
Y_3 = UnitY(Factor=".5")
series_4 = Series(Start=1, Step=1, Count=multiplication_3)
addition_3 = Addition(A=X_3, B=Y_3)
move_3 = Move(Geometry=zeropoints_2, Motion=addition_3)  # -> Geometry, Transform
tag_3 = TextTag(Location=move_3.Geometry, Text=series_4, Colour=ColourSwatch(SwatchColor=RGB(255, 0, 0)))

# ----
drawgrid_3 = DrawGrid(A_3=zeropoints_2, A=xy_dimension_3, A_2=xy_dimension_3)
geo_3 = Geometry(drawgrid_3)

# ==== cluster DrawGrid
A = ClusterInput()
A_2 = ClusterInput()
B = ClusterInput()
A_3 = ClusterInput()
multiplication = Multiplication(A=A, B=B)
multiplication_2 = Multiplication(A=A_2, B=B)
pt = ConstructPoint(XCoordinate=multiplication, YCoordinate=multiplication_2, ZCoordinate=0)
addition = Addition(A=A_3, B=pt)
multiplication_3 = Multiplication(A=B, B="-.5")
xy = XYPlane(Origin=addition)
rec_2pt = Rectangle2Pt(Plane=xy, PointA=A_3, PointB=addition, Radius=0)  # -> Rectangle, Length
pt_2 = ConstructPoint(XCoordinate=multiplication_3, YCoordinate=multiplication_3, ZCoordinate=multiplication_3)
move = Move(Geometry=rec_2pt.Rectangle, Motion=pt_2)  # -> Geometry, Transform
G = ClusterOutput(move.Geometry)
